# Grasshopper definition TestConnection.gh (Grasshopper 1.0.7)
# Copyright: 2021
# plug-ins: GrasshopperRadianceLinuxConnector, LadybugGrasshopper

panel = Panel("""oneMeshmaterial
twoMeshesmaterial""")

# ----
# Connect
toggle = BooleanToggle(True)
connect_ssh = ConnectSSH(User="mss", Ip="127.0.0.1", Password="_prompt", _port=22, Connect=toggle)  # -> Status, Run
panel_2 = Panel(connect_ssh.Status)

panel_3 = Panel("""echo $PATH
genbox""")
falsestart = LBFalseStartToggle(False)
execute_ssh = ExecuteSSH(SSHCommands=panel_3, Run=falsestart)  # -> Stdout, Stderr, Log, Success, Run
panel_4 = Panel(execute_ssh.Stderr)
panel_5 = Panel(execute_ssh.Stdout)

# ----
# Check if ximage and other x-commands work.
# Must have Xlaunch running on windows with disabled access control
panel_6 = Panel("""export "DISPLAY=$(ip route list default | awk '{print $3}'):0"
export "LIBGL_ALWAYS_INDIRECT = 1"
xclock&""")
falsestart_2 = LBFalseStartToggle(False)
execute_ssh_2 = ExecuteSSH(SSHCommands=panel_6, Run=falsestart_2)  # -> Stout, Errors, Errors_2, Success, Run

falsestart_3 = LBFalseStartToggle(False)
execute_ssh_3 = ExecuteSSH(SSHCommands=["cat ~/.bashrc", "dwd | tee ~/simulation/log.txt"], Run=falsestart_3)  # -> Stdout, Stderr, Log, Success, Run
panel_7 = Panel(execute_ssh_3.Stdout)
panel_8 = Panel(execute_ssh_3.Log)
panel_9 = Panel(execute_ssh_3.Stderr)

# ----
# test xview commands (xclock)
panel_10 = Panel("""export "DISPLAY=$(ip route list default | awk '{print $3}'):0"
export "LIBGL_ALWAYS_INDIRECT = 1"
xclock&""")
falsestart_4 = LBFalseStartToggle(False)
execute_ssh_4 = ExecuteSSH(SSHCommands=panel_10, Run=falsestart_4)  # -> Stdout, Stderr, Log, Success, Run

# ----
# Test connection
testconnection = TestConnection()  # -> Status, Errors
panel_11 = Panel(testconnection.Status)
panel_12 = Panel(testconnection.Errors)

# ----
# Run a SSH Command
panel_13 = Panel("""cd ~/simulation
pwd
ls
echo "lol" > ~/simulation/points.pts""")
falsestart_5 = LBFalseStartToggle(False)
execute_ssh_5 = ExecuteSSH(SSHCommands=panel_13, Run=falsestart_5)  # -> Stdout, Stderr, Log, Success, Run
# export PATH=$PATH.:/usr/local/radiance/bin
# export RAYPATH=.:/usr/local/radiance/lib
# obj2rad -m /home/mss/simulation/mapping.map -f /home/mss/simulation/twoMeshes4.obj 2>&1 1>/home/mss/simulation/x.rad
# head /home/mss/simulation/x.rad
panel_14 = Panel(execute_ssh_5.Stdout)

panel_15 = Panel("""MeshOneBox
MeshTwoBoxes""")
graft = GraftTree(Tree=panel, IncludeEmptyLists=True, IncludeNullItems=True)
mesh = Mesh(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)
mesh_2 = Mesh(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)
falsestart_6 = LBFalseStartToggle(True)

# ----
# grid points
rectangle = Rectangle(Plane=PlaneXY(-194.7254335, -90.60693642, 0), XSize=Domain(-5, 500), YSize=Domain(-3, 300), Radius=0)  # -> Rectangle, Length
sdivide = DivideSurface(Surface=rectangle.Rectangle, UCount=10, VCount=10)  # -> Points, Normals, Parameters
points2pts = PointsToPts(Points=flatten(sdivide.Points), Vectors=Vector(0, 0, 1), Name="points", Run=falsestart_6)  # -> PtsFile, Run

graft_2 = GraftTree(Tree=panel_15, IncludeEmptyLists=True, IncludeNullItems=True)
entwine = Entwine(Branch00=mesh_2, Branch01=mesh, FlattenInputs=True)
panel_16 = Panel(execute_ssh_5.Stderr)

# ----
# Geometry
mesh2obj = MeshToObj(Mesh=entwine, Name=graft_2, ModifierName=graft, Run=falsestart_6)  # -> ObjFiles, MapFile, Run
obj2rad = ObjToRad(ObjFiles=mesh2obj.ObjFiles, MapFile=mesh2obj.MapFile, Run=mesh2obj.Run)  # -> Status, RadFiles, Run

# ----
# Setup materials
panel_17 = Panel("""0.5
0.7""")
panel_18 = Panel("echo \"<mats>\" >~/simulation/allmats.mat;echo \"~/simulation/allmats.mat\"")
opaquegreymat = OpaqueGreyMat(Name=flatten(graft), Reflectance_0_1=panel_17, Specularity=0, Roughness=0)  # -> RadMaterials, RadMaterialList
rep = ReplaceText(Text=panel_18, Find="<mats>", Replace=opaquegreymat.RadMaterials, RecursiveReplace=False)
execute_ssh_6 = ExecuteSSH(SSHCommands=rep, Run=obj2rad.Run)  # -> Stdout, Stderr, Log, Success, Run

# ----
# create WEA file
path = FilePath("C:\ladybug\NOR_OS_Alna.014870_TMYx.2004-2018\NOR_OS_Alna.014870_TMYx.2004-2018.epw")
upload = Upload(LocalFilePaths=path, Run=obj2rad.Run)  # -> Status, FilePaths, Run
rep_2 = ReplaceText(Text=upload.FilePaths, Find=".epw", Replace=".wea", RecursiveReplace=False)
panel_19 = Panel("""in
out""")
applyglobals = ApplyGlobals(Input="epw2wea <in> <out> 1>&2;echo <out>", AdditionalKeys=panel_19, AdditionalValues=[upload.FilePaths, rep_2])  # -> Output, Pairs
execute_ssh_7 = ExecuteSSH(SSHCommands=applyglobals.Output, Run=upload.Run)  # -> Stdout, Stderr, Log, Success, Run
panel_20 = Panel(execute_ssh_7.Stdout)
panel_21 = Panel(execute_ssh_7.Stderr)

# ----
# 5 phase bash script from andy mcneil
panel_22 = Panel("""#!/bin/bash

procs=4

### First let me download and unpacking Axel\'s files for rtcontrib lesson

printf "\nDownloading Axels rtcontrib lesson files...\n"
curl -O http://www.jaloxa.eu/resources/radiance/documentation/docs/rtcontrib_lesson.tgz
tar -xf rtcontrib_lesson.tgz
mv rtcontrib_lesson 5p_tutorial_examples

cd 5p_tutorial_examples

mkdir bsdf hourlypics hourlypics_dir hourlypics_ds hourlyresult \
	matrices octs viewpics viewpics_dir viewpics_ds
	
### Let me download the weather data file for you
printf "\nDownloading weather data...\n"
curl -O http://apps1.eere.energy.gov/buildings/energyplus/weatherdata/4_north_and_central_america_wmo_region_4/1_usa/USA_CA_Oakland.Intl.AP.724930_TMY3.zip
tar -xf USA_CA_Oakland.Intl.AP.724930_TMY3.zip
rm USA_CA_Oakland.Intl.AP.724930_TMY3.ddy 
rm USA_CA_Oakland.Intl.AP.724930_TMY3.stat
rm USA_CA_Oakland.Intl.AP.724930_TMY3.zip 
mv USA_CA_Oakland.Intl.AP.724930_TMY3.epw skies/.

# grabbing reinsrc.cal from CVS
printf "\nDownloading reinsrc.cal...\n"
curl -O http://radiance-online.org/cgi-bin/viewcvs.cgi/ray/src/cal/cal/reinsrc.cal

### Section 6.1 - Model adjustments for five-phase simulation
printf "\nMaking model adjustments...\n"
cat <<EOF > objects/testroom_Swall.rad
!genbox wall_mat wall_s_bottom 4 .3 1 |xform -t 0 -.3 0
!genbox wall_mat wall_s_top 4 .3 .5 |xform -t 0 -.3 2
!genbox wall_mat wall_s_west .5 .3 1 |xform -t 0 -.3 1
!genbox wall_mat wall_s_west .5 .3 1 |xform -t 3.5 -.3 1
EOF

cat <<EOF > objects/testroom.rad
!genbox floor_mat floor 4.6 6.6 .3 |xform -t -.3 -.3 -.3
!genbox ceiling_mat ceiling 4.6 6.6 .3 |xform -t -.3 -.3 2.5

!genbox wall_mat wall_w .3 6.6 2.5 |xform -t -.3 -.3 0
!genbox wall_mat wall_e .3 6.6 2.5 |xform -t 4 -.3 0
!genbox wall_mat wall_n 4 .3 2.5 |xform -t 0 6 0
EOF

cat <<EOF > objects/glazing.rad
void glass glazing
0
0
3 0.73 0.73 0.73

glazing polygon glass
0
0
12    0.5  -0.25   1
        0.5  -0.25   2
        3.5  -0.25   2
        3.5  -0.25   1
EOF

cat <<EOF > objects/venetianblind.rad
void plastic blindslat
0
0
5 .65 .65 .65 .01 0 

!genblinds blindslat blinds .05 3 1 25 0 +r .15 | xform -rz -90 -t 0.5 -.15 1 
EOF

cat <<EOF > objects/viewmtxsurf.rad
void glow viewsurf
0
0
4 1 1 1 0

viewsurf polygon inside
0
0
12    0.5   0   1
        0.5   0   2
        3.5   0   2
        3.5   0   1
EOF

cat <<EOF > objects/daymtxsurf.rad
void plastic daymtxsurf
0
0
5 0 0 0 0 0

daymtxsurf polygon outside
0
0
12    0.5   -0.3   1
        0.5   -0.3   2
        3.5   -0.3   2
        3.5   -0.3  1
EOF

cat <<EOF > objects/glazing_bsdf.rad
void BSDF BSDFproxy
6 0.30 bsdf/fullwindow_t45.xml 0 0 1 .
0
0

BSDFproxy polygon inside
0
0
12    0.5   0   1
        0.5   0   2
        3.5   0   2
        3.5   0   1
EOF

cat <<EOF >> materials/testroom.mat
void plastic black
0
0
5 0 0 0 0 0
EOF

### Section 6.2 - Creating BSDFs
xform -rz 180 -rx -90 -t 4 0 0 objects/glazing.rad objects/venetianblind.rad materials/testroom.mat \
	objects/testroom_Swall.rad > bsdf/fullwindow.rad

### I am going to save you the trouble of generating the High-Res BSDF
#genBSDF -n $procs +f +b -geom meter -dim 0.5 3.5 1 2 -.3 0 -t4 5 \
#	bsdf/fullwindow.rad > bsdf/fullwindow_t45.xml
printf "\nDownloading tensor tree BSDF...\n"
curl -o bsdf/fullwindow_t45.xml http://www.radiance-online.org/learning/tutorials/fivephasetutorialfiles/fullwindow_t45.xml

### I will also save you the trouble with the low-res BSDF
#bsdf2klems bsdf/fullwindow_t45.xml > bsdf/fullwindow_klems.xml
#genBSDF -n $procs +f +b -geom meter -dim 0.5 3.5 1 2 -.3 0 \
#	bsdf/fullwindow.rad > bsdf/fullwindow_klems.xml
printf "\nDownloading klems BSDF...\n"
curl -o bsdf/fullwindow.xml http://www.radiance-online.org/learning/tutorials/fivephasetutorialfiles/fullwindow.xml

### Section 6.3 - View matrix (V)
printf "\nDoing 5-phase simulation for sensor points...\n"
oconv materials/testroom.mat objects/daymtxsurf.rad objects/ground.rad objects/testroom.rad \
	objects/testroom_Swall.rad objects/viewmtxsurf.rad skies/sky_white.rad \
	objects/viewmtxsurf.rad objects/daymtxsurf.rad > octs/model_3ph.oct
printf "\nView Matrix\n"
time rcontrib < data/photocells.pts -n $procs -f klems_int.cal -b kbinS -bn Nkbins -m viewsurf \
	-I+ -ab 10 -ad 65536 -lw 1.52e-5 octs/model_3ph.oct > matrices/viewmatrix.vmx

### Section 6.4 - Direct view matrix (Vd)
printf "\nDirect View Matrix\n"
time rcontrib < data/photocells.pts -n $procs -f klems_int.cal -b kbinS -bn Nkbins -m viewsurf \
	-I+ -ab 1 -ad 65536 -lw 1.52e-5 octs/model_3ph.oct > matrices/viewmatrix_direct.vmx

### Section 6.5 - Daylight matrix (D)
printf "\nDaylight Matrix\n"
time genklemsamp -c 1000 -vd 0 -1 0 objects/daymtxsurf.rad | \
	rcontrib -n $procs -c 1000 -ab 2 -ad 1024 -e MF:1 -f reinhart.cal -b rbin -bn Nrbins \
		-m sky_glow octs/model_3ph.oct > matrices/daylightmatrix.dmx

### Section 6.6 - Direct daylight matrix (Dd)
printf "\nDirect Daylight Matrix\n"
xform -m black objects/testroom_Swall.rad objects/testroom.rad objects/ground.rad \
	objects/venetianblind.rad | oconv materials/testroom.mat - objects/viewmtxsurf.rad \
	objects/daymtxsurf.rad skies/sky_white.rad > octs/model_allblack.oct

time genklemsamp -c 1000 -vd 0 -1 0 objects/daymtxsurf.rad | \
	rcontrib -n $procs -c 1000 -ab 0 -e MF:1 -f reinhart.cal -b rbin -bn Nrbins \
		-m sky_glow octs/model_allblack.oct > matrices/daylightmatrix_direct.dmx

### Section 6.7 - Direct sun coefficient matrix (Cds)
printf "\nDirect Sun Coefficient Matrix\n"
echo void light solar 0 0 3 1e6 1e6 1e6 > skies/suns.rad
cnt 5185  |  rcalc -e MF:6 -f reinsrc.cal -e Rbin=recno \
	-o 'solar source sun 0 0 4 ${ Dx } ${ Dy } ${ Dz } 0.533' >> skies/suns.rad

xform -m black objects/testroom_Swall.rad objects/testroom.rad objects/ground.rad \
	| oconv materials/testroom.mat - objects/glazing.rad objects/venetianblind.rad \
		objects/glazing_bsdf.rad skies/suns.rad > octs/model_suns.oct

time rcontrib < data/photocells.pts -n $procs -I -ab 1 -ad 65536 -lw 1.52e-5 -dc 1 -dt 0 -dj 0 -st 1 -ss 0 -faf  \
	-e MF:6 -f reinhart.cal -b rbin -bn Nrbins -m solar \
	octs/model_suns.oct > matrices/directsun.dsmx

### Section 6.8 - Putting it all together
printf "\nCombining it all\n"
epw2wea skies/USA_CA_Oakland.Intl.AP.724930_TMY3.epw skies/OakLand.wea
gendaymtx -of skies/OakLand.wea > matrices/OakLand.smx
gendaymtx -of -d skies/OakLand.wea > matrices/OakLand_direct.smx
gendaymtx -5 -d -m 6 -of skies/OakLand.wea > matrices/OakLand_direct_m6.smx

time dctimestep -n 8760 -if matrices/viewmatrix.vmx bsdf/fullwindow.xml  \
	matrices/daylightmatrix.dmx matrices/OakLand.smx | \
	rcollate -h -oc 1 > i_3ph.txt

time dctimestep -n 8760 -if  matrices/viewmatrix_direct.vmx bsdf/fullwindow.xml  \
	matrices/daylightmatrix_direct.dmx matrices/OakLand_direct.smx | \
	rcollate -h -oc 1 > i_ds3ph.txt

time dctimestep -n 8760 -if matrices/directsun.dsmx matrices/OakLand_direct_m6.smx | \
	rcollate -h -oc 1 > i_ds5ph.txt

rlam i_3ph.txt i_ds3ph.txt i_ds5ph.txt | \
	rcalc -e 'r=$1-$4+$7;g=$2-$5+$8;b=$3-$6+$9' \
	-e '$1=179*(.265*r+.670*g+.065*b)' | \
	rcollate -h -fa1 -ic 8760 -t > illum.txt

printf "\nAll done with example 1!  look at illum.txt for the result.\n"

printf "\n\n\nDoing 5-phase simulation for rendering...\n"
### 7.1	View matrix (V)
printf "\nView Matrix...\n"
time vwrays -vf views/back.vf  -ff -x 500 -y 500 \
	| rcontrib `vwrays -vf views/back.vf  -x 500 -y 500 -d` -n $procs -ffc -fo -o viewpics/back_%03d.hdr \
		-f klems_int.cal -b kbinS -bn Nkbins -m viewsurf \
		-ab 10 -ad 65536 -lw 1.52e-5 octs/model_3ph.oct

### 7.2	Direct view matrix (Vd)	
printf "\nDirect View Matrix...\n"	
time vwrays -vf views/back.vf  -ff -x 500 -y 500 \
	| rcontrib `vwrays -vf views/back.vf  -x 500 -y 500 -d` -n $procs -ffc -fo -o viewpics_dir/back_%03d.hdr \
		-f klems_int.cal -b kbinS -bn Nkbins -m viewsurf \
		-ab 1 -ad 65536 -lw 1.52e-5 octs/model_3ph.oct

### 7.5	Direct sun coefficient matrix (Cds)
printf "\nDirect Coefficient Matrix...\n"
ulimit -n 9999
xform -m black objects/testroom_Swall.rad objects/testroom.rad objects/ground.rad | \
	oconv materials/testroom.mat - objects/venetianblind.rad > octs/model_nosuns.oct
time vwrays -c 4 -pj 1 -fa -vf views/back.vf -x 500 -y 500 | \
	rtrace -h- -opn -faa -ab 0 octs/model_nosuns.oct | \
	rcontrib `vwrays -vf views/back.vf -x 500 -y 500 -d` -n $procs -fac -fo -o viewpics_ds/back_%04d.hdr \
	-e MF:6 -f reinhart.cal -b rbin -bn Nrbins -m solar -c 4 -I -ab 1 -ad 100 -dt 0 -dc 1 -lw 1e-2 octs/model_suns.oct

oconv materials/testroom.mat objects/testroom_Swall.rad objects/testroom.rad \
	objects/ground.rad objects/glazing.rad objects/venetianblind.rad \
	objects/daymtxsurf.rad > octs/model_material.oct
time rpict -x 1000 -y 1000 -vf views/back.vf -ps 1 -pj 1 -av 0.31831 0.31831 0.31831 -aa 0 \
	octs/model_material.oct | pfilt -x /2 -y /2 -1 -e 1 > materialmap.hdr  

### 7.6	Putting it all together
printf "\nPutting it together...\n"
time dctimestep -n 8760 -if -o hourlypics/back_%04d.hdr viewpics/back_%03d.hdr \
	bsdf/fullwindow.xml matrices/daylightmatrix.dmx matrices/OakLand.smx 

time dctimestep -n 8760 -if -o hourlypics_dir/back_%04d.hdr viewpics_dir/back_%03d.hdr \
	bsdf/fullwindow.xml matrices/daylightmatrix_direct.dmx matrices/OakLand_direct.smx 

time dctimestep -n 8760 -if -o hourlypics_ds/back_%04d.hdr viewpics_ds/back_%04d.hdr \
	matrices/OakLand_direct_m6.smx

time for t in {1..8760} 
do ts=`printf %04d $t `
pcomb -e 'lo=li(1)-li(2)+li(3)*li(4)' -o hourlypics/back_${ts}.hdr -o hourlypics_dir/back_${ts}.hdr \
	-o hourlypics_ds/back_${ts}.hdr -o materialmap.hdr > hourlyresult/back_${ts}.hdr 
done
printf "\nAll Done with 5-phase Rendering sim\n"
pcond hourlyresult/back_0015.hdr | ximage &""")

# ----
# create octree
rad_files = Text(obj2rad.RadFiles)
mat_files = Text(execute_ssh_6.Stdout)
join = TextJoin(Text=flatten([mat_files, rad_files]), Join=" ")
rep_3 = ReplaceText(Text="oconv -f <rads> > ~/simulation/myscene.oct", Find="<rads>", Replace=join, RecursiveReplace=False)
execute_ssh_8 = ExecuteSSH(SSHCommands=rep_3, Run=execute_ssh_6.Run)  # -> Stdout, Stderr, Log, Success, Run
panel_23 = Panel(execute_ssh_8.Log)

txt = Text(execute_ssh_7.Stdout)
rep_4 = ReplaceText(Text=txt, Find=".wea", Replace=".mtx", RecursiveReplace=False)
panel_24 = Panel("""export PATH=$PATH.:/usr/local/radiance/bin
export RAYPATH=.:/usr/local/radiance/lib
objline ~/simulation/twoMeshes5.rad | meta2tga -x 1048 -y 1048 | ra_t8 -r > ~/simulation/test.hdr
normtiff ~/simulation/test.hdr ~/simulation/test.tif
convert ~/simulation/test.tif ~/simulation/test.png
echo "C:\Users\mm1013\simulation\test.png"
""")
panel_25 = Panel("""wea
mtx""")
applyglobals_2 = ApplyGlobals(Input="gendaymtx -O0 -d -r 0.0 -u <wea>><mtx>", AdditionalKeys=panel_25, AdditionalValues=[txt, rep_4])  # -> Output, Pairs
execute_ssh_9 = ExecuteSSH(SSHCommands=applyglobals_2.Output, Run=execute_ssh_7.Run)  # -> Stdout, Stderr, Log, Success, Run
panel_26 = Panel(execute_ssh_9.Stderr)
falsestart_7 = LBFalseStartToggle(False)
execute_ssh_10 = ExecuteSSH(SSHCommands=panel_24, Run=falsestart_7)  # -> Stdout, Stderr, Log, Success, Run
panel_27 = Panel(execute_ssh_10.Stderr)
imageviewer = LBImageViewer(ImagePath_=execute_ssh_10.Stdout, _scale_=1, DisableClickable=False, SaveImgWithCoords=False, scale=1)  # -> ImagePath, Values, GIF

# ----
# Setup globals
# And test them
panel_28 = Panel("""C:\TEST
testProjectName""")
panel_29 = Panel("""TESTDIR
ProjName""")
globals = SetupGlobals(Keys=panel_29, Values=panel_28)
panel_30 = Panel(globals)
panel_31 = Panel("""<TESTDIR> <TestDir> <AnotherDir>
<ProjName>""")

applyglobals_3 = ApplyGlobals(Input=panel_31)  # -> Output, Pairs

panel_32 = Panel(applyglobals_3.Output)
